# Grasshopper definition Os_Gcode_01.gh (Grasshopper 1.0.7)

srf = Surface(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)
contour = Contour(Shape=srf, Point=Point(0, 0, 0), Direction=Vector(0, 0, 1), Distance=Slider(1, range=0..100))
crv = Curve(contour)
cp = ControlPoints(Curve=crv)  # -> Points, Weights, Knots
shift = ShiftList(List=cp.Points, Shift=1, Wrap=invert(True))
panel = Panel(cp.Points)
crv_2 = Curve(contour)
nurbs = NurbsCurve(Vertices=flatten(shift), Degree=3, Periodic=False)  # -> Curve, Length, Domain
nurbs_2 = NurbsCurve(Vertices=cp.Points, Degree=3, Periodic=False)  # -> Curve, Length, Domain
explode = Explode(Curve=crv_2, Recursive=True)  # -> Segments, Vertices
pdecon = Deconstruct(Point=flatten(cp.Points))  # -> XComponent, YComponent, ZComponent
panel_2 = Panel(explode.Segments)
len = Length(Curve=explode.Segments)
ins = InsertItems(List=len, Item="0", Indices="0", Wrap=True)
panel_3 = Panel(ins)
ma = MassAddition(Input=flatten(ins))  # -> Result, PartialResults
panel_4 = Panel(ma.PartialResults)
multiplication = Multiplication(A="30", B="60")
python = GhPythonScript(
    H="G1",
    G=" F",
    K=multiplication,
    A=" X",
    B=pdecon.XComponent,
    C=" Y",
    D=pdecon.YComponent,
    E=" Z",
    F=pdecon.ZComponent,
    I=" E",
    J=ma.PartialResults)  # -> out, a
# ---------- python: Python ----------
__author__ = "Usuario Dell"
__version__ = "2021.02.11"

import rhinoscriptsyntax as rs

a = H + G + str(K) + A + str(B) + C + str(D) + E + str(F) + I + str(J)
# ---------- end python ----------
concat = Concatenate(
    FragmentH="G1",
    FragmentG=" F",
    FragmentK=multiplication,
    FragmentA=" X",
    FragmentB=pdecon.XComponent,
    FragmentC=" Y",
    FragmentD=pdecon.YComponent,
    FragmentE=" Z",
    FragmentF=pdecon.ZComponent,
    FragmentI=" E",
    FragmentJ=ma.PartialResults)
panel_5 = Panel(python.a)
panel_6 = Panel("""; -- START GCODE --
G90
M82
G28
G92 E0.0000
G1 E-4.0000 F6000
; -- end of START GCODE --""")
panel_7 = Panel("""; -- END GCODE --
G92 E0.0000
G1 E-4.0000 F6000
G28
; -- end of END GCODE --""")
merge = Merge(Data1=flatten(panel_6), Data2=flatten(concat), Data3=flatten(panel_7))
panel_8 = Panel(concat)
panel_9 = Panel(merge)
