# Grasshopper definition vicio-animation-03-sevan-sevan3.gh (Grasshopper 1.0.8)
# plug-ins: MeshEdit Components, treesloth01, Pufferfish, Anemone, Human, horsterCameraControl, Tarsier

sqgrid = Square(
    Plane=PlaneXY(0, 0, 0),
    Size=Slider(0.25, range=0..1),
    ExtentX=Slider(36, range=0..100),
    ExtentY=Slider(40, range=0..100))  # -> Cells, Points
crv = Curve(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)
flatten = FlattenTree(Tree=sqgrid.Cells, Path="{0}")
boundary = BoundarySurfaces(Edges=crv)
crv_2 = Curve(flatten)
crv_3 = Curve(<curve referenced from the Rhino model>)
crv_4 = Curve(<curve referenced from the Rhino model>)
area = Area(Geometry=crv_2)  # -> Area, Centroid
boundary_2 = BoundarySurfaces(Edges=crv_4)
srf = Surface(boundary)
incurve = PointInCurve(Point=area.Centroid, Curve=crv_3)  # -> Relationship, Point
cull = CullPattern(List=crv_2, CullPattern=incurve.Relationship)
srf_2 = Surface(boundary)
number_slider = Slider(0.2, range=0..1)
rec = Rectangle(srf_2)
number_slider_2 = Slider(0.1, range=0..1)
explode = Explode(Curve=rec, Recursive=True)  # -> Segments, Vertices
len = Length(Curve=explode.Segments)
division = Division(A=len, B=Slider(0.25, range=0..1))
round = Round(Number=division)  # -> Nearest, Floor, Ceiling
item = ListItem(List=round.Nearest, Index=0, Wrap=True)  # -> Item, Item1, Item2
mplane = MeshPlane(Boundary=rec, WidthCount=item.Item, HeightCount=item.Item1)  # -> Mesh, Area
explode_2 = MeshExplode(Mesh=mplane.Mesh, Interpolate=False)
crv_5 = Curve([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])
crv_6 = Curve([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])
crv_7 = Curve([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])
merge = Merge(Data1=crv_5, Data2=crv_7, Data3=crv_6)  # -> flatten(Result)
area_2 = Area(Geometry=explode_2)  # -> Area, Centroid
dom = ConstructDomain(DomainStart=Slider(0, range=0..10), DomainEnd=Slider(60, range=0..100))
lng = ListLength(List=merge)
random = Random(Range=dom, Number=lng, Seed=2)
lng_2 = ListLength(List=area_2.Centroid)
crv_8 = Curve(graft([<curve referenced from the Rhino model> x4]))  # disabled
panel = Panel("500")
number_slider_3 = Slider(0.033, range=0..1)  # disabled
swatch = ColourSwatch(SwatchColor=RGB(97, 97, 97))  # disabled
repeat = RepeatData(Data=ColourSwatch(SwatchColor=RGB(0, 0, 0)), Length=lng_2)
ext = ExtendCurve(Curve=merge, Type=0, Start=random, End=Slider(0, range=0..10))  # -> flatten(Curve)
swatch_2 = ColourSwatch(SwatchColor=RGB(219, 219, 219))  # disabled
len_2 = Length(Curve=ext)
crv_9 = Curve(<curve referenced from the Rhino model>)
loop_start = LoopStart(Repeat=Slider(600, range=0..600), Data=repeat)  # -> port, Counter, Data
dash = DashPattern(Curve=reparameterize(crv_8), Pattern=number_slider_3)  # -> Dashes, Gaps; disabled
series = Series(Start=Slider(0, range=0..53), Step=1, Count=Slider(27, range=0..53))
sort = SortList(Keys=len_2, ValuesA=ext)  # -> Keys, ValuesA
tables = Curve([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])
round_center_table = Curve(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)
panel_2 = Panel(loop_start.Data)
panel_3 = Panel(loop_start.Counter)
number_slider_4 = Slider(0.023, range=0..1)  # disabled
previewlw = CustomPreviewLineweights(Geometry=dash.Dashes, Shader=swatch_2, Absolute=False)  # disabled
item_2 = ListItem(List=sort.ValuesA, Index=series, Wrap=True)  # -> graft(Item)
crv_10 = Curve([tables, round_center_table])
number_slider_5 = Slider(0.1, range=0..0.1)
swatch_3 = ColourSwatch(SwatchColor=RGB(255, 255, 255))  # disabled
swatch_4 = ColourSwatch(SwatchColor=RGB(194, 194, 194))  # disabled
tables_2 = Curve([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])
round_center_table_2 = Curve(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)
lng_3 = ListLength(List=area_2.Centroid)
divlength = DivideLength(Curve=item_2, Length=Slider(0.2, range=0..1))  # -> Points, Tangents, Parameters
dash_2 = DashPattern(Curve=reparameterize(graft(crv_10)), Pattern=number_slider_4)  # -> Dashes, Gaps; disabled
number_slider_6 = Slider(0.2, range=0..1)  # disabled
incurve_2 = PointInCurve(Point=area_2.Centroid, Curve=crv_9)  # -> Relationship, Point
repeat_2 = RepeatData(Data=ColourSwatch(SwatchColor=RGB(255, 255, 255)), Length=lng_3)
swatch_5 = ColourSwatch(SwatchColor=RGB(56, 56, 56))  # disabled
crv_11 = Curve([tables_2, round_center_table_2])
cull_2 = CullPattern(List=repeat_2, CullPattern=incurve_2.Relationship)
cull_3 = CullPattern(List=area_2.Centroid, CullPattern=incurve_2.Relationship)
pt = Point(cull_3)
divlength_2 = DivideLength(Curve=item_2, Length=Slider(0.2, range=0..1))  # -> Points, Tangents, Parameters
swatch_6 = ColourSwatch(SwatchColor=RGB(255, 255, 255))
incurves = PointInCurves(Point=pt, Curves=crv_10)  # -> Relationship, Index, Point
swatch_7 = ColourSwatch(SwatchColor=RGB(194, 194, 194))
divlength_3 = DivideLength(Curve=item_2, Length=number_slider_6)  # -> Points, Tangents, Parameters; disabled
dash_3 = DashPattern(Curve=reparameterize(graft(crv_11)), Pattern=Slider(0.023, range=0..1))  # -> Dashes, Gaps
construct = ConstructPointCloud(Points=cull_3, Colours=cull_2)
previewlw_2 = CustomPreviewLineweights(Geometry=dash_2.Dashes, Shader=swatch_4, Absolute=False)  # disabled
previewlw_3 = CustomPreviewLineweights(Geometry=crv_9, Shader=swatch_3, Absolute=False)  # disabled
number_slider_7 = Slider(0.9, range=0..1)
pt_2 = Point(cull_3)
swatch_8 = ColourSwatch(SwatchColor=RGB(56, 56, 56))
item_3 = ListItem(List=divlength_2.Points, Index=loop_start.Counter, Wrap=invert(True))  # -> flatten(Item)
cull_4 = CullPattern(List=pt, CullPattern=invert(incurves.Relationship))
item_4 = ListItem(List=divlength_3.Points, Index=loop_start.Counter, Wrap=invert(True))  # disabled
kdconstruct = ConstructKDTree(PointCloud=construct)
incurves_2 = PointInCurves(Point=pt_2, Curves=crv_11)  # -> Relationship, Index, Point
divlength_4 = DivideLength(Curve=item_2, Length=Slider(0.2, range=0..1))  # -> Points, Tangents, Parameters
clean = CleanTree(RemoveNulls=True, RemoveInvalid=True, RemoveEmpty=False, Tree=flatten(item_3))
previewlw_4 = CustomPreviewLineweights(Geometry=dash_3.Dashes, Shader=ColourSwatch(SwatchColor=RGB(138, 138, 138)), Absolute=False)
previewlw_5 = CustomPreviewLineweights(Geometry=crv_9, Shader=ColourSwatch(SwatchColor=RGB(196, 196, 196)), Absolute=False)
rec_2 = DataRecorder(item_4, DataLimit=-10, RecordData=True)  # disabled
cull_5 = CullPattern(List=pt_2, CullPattern=invert(incurves_2.Relationship))
kdsample = SampleKDTree(KDTree=kdconstruct, Points=clean, Range=Slider(0.2, range=0..1), MaximumPointsReturned=1024)
lng_4 = ListLength(List=divlength_4.Points)
lng_5 = ListLength(List=divlength.Points)
dam = DataDam(DataA=rec_2, BufferDelay=10000000, BufferMode=0)  # disabled
cset = CreateSet(List=flatten(kdsample))  # -> Set, Map
multiplication = Multiplication(A=lng_4, B=Slider(0, range=0..1))
multiplication_2 = Multiplication(A=lng_5, B=Slider(1, range=0..1))
number_slider_8 = Slider(0.05, range=0..1)
number_slider_9 = Slider(0.0606, range=0..1)
cull_6 = CullPattern(List=explode_2, CullPattern=incurve_2.Relationship)
medges = MeshEdges(Mesh=cull_6)  # -> NakedEdges, InteriorEdges, NonManifoldEdges; disabled
join = JoinCurves(Curves=flatten(medges.NakedEdges), Preserve=False)  # disabled
medges_2 = MeshEdges(Mesh=cull_6)  # -> NakedEdges, InteriorEdges, NonManifoldEdges
previewlw_6 = CustomPreviewLineweights(Geometry=join, Shader=swatch_5, Absolute=False)  # disabled
join_2 = JoinCurves(Curves=flatten(medges_2.NakedEdges), Preserve=False)
demesh = DeconstructMesh(Mesh=cull_6)  # -> Vertices, Faces, Colours, Normals
area_3 = Area(Geometry=cull_6)  # -> Area, Centroid
previewlw_7 = CustomPreviewLineweights(Geometry=join_2, Shader=ColourSwatch(SwatchColor=RGB(227, 227, 227)), Absolute=False)
series_2 = Series(Start=0, Step=1, Count=multiplication)
panel_4 = Panel(cset.Set)
series_3 = Series(Start=0, Step=1, Count=multiplication_2)
item_5 = ListItem(List=loop_start.Data, Index=cset.Set, Wrap=True)
swatch_9 = ColourSwatch(SwatchColor=RGB(53, 25, 82))
item_6 = ListItem(List=divlength_4.Points, Index=series_2, Wrap=invert(True))  # -> flatten(Item)
item_7 = ListItem(List=divlength.Points, Index=series_3, Wrap=invert(True))  # -> flatten(Item)
number_slider_10 = Slider(0.05, range=0..1)
number_slider_11 = Slider(0.0606, range=0..1)
panel_6 = Panel(item_5)
divlength_5 = DivideLength(Curve=item_2, Length=Slider(0.2, range=0..1))  # -> Points, Tangents, Parameters
clean_2 = CleanTree(RemoveNulls=True, RemoveInvalid=True, RemoveEmpty=False, Tree=flatten(item_7))
neg = Negative(Value=number_slider_8)
panel_7 = Panel("1")
number_slider_12 = Slider(0.0606, range=0..1)
clean_3 = CleanTree(RemoveNulls=True, RemoveInvalid=True, RemoveEmpty=False, Tree=flatten(item_6))
ins = InsertItems(List=graft(item_5), Item=ColourSwatch(SwatchColor=RGB(111, 31, 191)), Indices="1", Wrap=invert(True))  # -> simplify(List)
area_4 = Area(Geometry=cull_6)  # -> Area, Centroid
dom_2 = ConstructDomain(DomainStart=number_slider_8, DomainEnd=neg)
interp = InterpolateData(Data=ins, Parameter=Slider(0.2, range=0..1), Interpolation=2)  # -> flatten(Value)
divlength_6 = DivideLength(Curve=item_2, Length=Slider(0.2, range=0..1))  # -> Points, Tangents, Parameters
neg_2 = Negative(Value=number_slider_10)
neg_3 = Negative(Value=number_slider_12)
rectangle = Rectangle(Plane=cull_4, XSize=dom_2, YSize=dom_2, Radius=0)  # -> Rectangle, Length
panel_8 = Panel("0.5")
number_slider_13 = Slider(0.051, range=0..1)
number_slider_14 = Slider(0.05, range=0..1)
shift = ShiftPaths(Data=divlength_5.Points, Offset=-1)
dom_3 = ConstructDomain(DomainStart=number_slider_10, DomainEnd=neg_2)
pt_3 = Point(cull_3)
ahsv = SplitAHSV(Colour=interp)  # -> Alpha, Hue, Saturation, Value
ahsv_2 = SplitAHSV(Colour=loop_start.Data)  # -> Alpha, Hue, Saturation, Value
panel_9 = Panel("0.9")
dom_4 = ConstructDomain(DomainStart=number_slider_12, DomainEnd=neg_3)
explode_3 = Explode(Curve=rectangle.Rectangle, Recursive=True)  # -> Segments, Vertices
cps = ClosestPoints(Point=clean_3, Cloud=cull_3, Count=3)  # -> ClosestPoint, CPIndex, Distance
addition = Addition(A=ahsv.Value, B="0.5")
subtraction = Subtraction(A=ahsv_2.Value, B="0.01")
cps_2 = ClosestPoints(Point=clean_2, Cloud=cull_3, Count=3)  # -> ClosestPoint, CPIndex, Distance
rectangle_2 = Rectangle(Plane=cull_5, XSize=dom_3, YSize=dom_3, Radius=0)  # -> Rectangle, Length
item_8 = ListItem(List=explode_3.Vertices, Index=0, Wrap=True)  # -> Item, Item1, Item2, Item3
number_slider_15 = Slider(0.051, range=0..1)
number_slider_16 = Slider(0.05, range=0..1)
neg_4 = Negative(Value=number_slider_13)
rectangle_3 = Rectangle(Plane=pt_3, XSize=dom_4, YSize=dom_4, Radius=0)  # -> Rectangle, Length
shift_2 = ShiftPaths(Data=divlength_6.Points, Offset=-1)
hsv = ColourHSV(Alpha=1, Hue=ahsv.Hue, Saturation=ahsv.Saturation, Value=addition)
hsv_2 = ColourHSV(Alpha=1, Hue=ahsv_2.Hue, Saturation=ahsv_2.Saturation, Value=subtraction)
number_slider_17 = Slider(0.05, range=0..1)
dom_5 = ConstructDomain(DomainStart=number_slider_13, DomainEnd=neg_4)
explode_4 = Explode(Curve=rectangle_2.Rectangle, Recursive=True)  # -> Segments, Vertices
explode_5 = Explode(Curve=rectangle_3.Rectangle, Recursive=True)  # -> Segments, Vertices
panel_10 = Panel(hsv)
rep = ReplaceText(Text=hsv_2, Find="0,0,0", Replace="255,255,255", RecursiveReplace=False)
item_9 = ListItem(List=explode_4.Vertices, Index=0, Wrap=True)  # -> Item, Item1, Item2, Item3
neg_5 = Negative(Value=number_slider_15)
replace = ReplaceItems(List=hsv_2, Item=hsv, Indices=cset.Set, Wrap=False)
col = Colour(rep)
item_10 = ListItem(List=explode_5.Vertices, Index=0, Wrap=True)  # -> Item, Item1, Item2, Item3
neg_6 = Negative(Value=number_slider_17)
rectangle_4 = Rectangle(Plane=item_8.Item, XSize=dom_5, YSize=dom_5, Radius=0)  # -> Rectangle, Length
rectangle_5 = Rectangle(Plane=item_8.Item2, XSize=dom_5, YSize=dom_5, Radius=0)  # -> Rectangle, Length
dom_6 = ConstructDomain(DomainStart=number_slider_15, DomainEnd=neg_5)
tstat = TreeStatistics(Tree=cps.ClosestPoint)  # -> Paths, Length, Count
dom_7 = ConstructDomain(DomainStart=number_slider_17, DomainEnd=neg_6)
area_5 = Area(Geometry=rectangle_5.Rectangle)  # -> Area, Centroid
area_6 = Area(Geometry=rectangle_4.Rectangle)  # -> Area, Centroid
loop_end = LoopEnd(port=loop_start.port, Exit=False, Data=replace, TimeOutVal=0, pausedState=False, state="Constant output")
panel_11 = Panel(col)
area_7 = Area(Geometry=cull_6)  # -> Area, Centroid
rectangle_6 = Rectangle(Plane=item_9.Item, XSize=dom_6, YSize=dom_6, Radius=0)  # -> Rectangle, Length
rectangle_7 = Rectangle(Plane=item_9.Item1, XSize=dom_6, YSize=dom_6, Radius=0)  # -> Rectangle, Length
rectangle_8 = Rectangle(Plane=item_9.Item3, XSize=dom_6, YSize=dom_6, Radius=0)  # -> Rectangle, Length
rectangle_9 = Rectangle(Plane=item_9.Item2, XSize=dom_6, YSize=dom_6, Radius=0)  # -> Rectangle, Length
rectangle_10 = Rectangle(Plane=item_10.Item, XSize=dom_7, YSize=dom_7, Radius=0)  # -> Rectangle, Length
rectangle_11 = Rectangle(Plane=item_10.Item2, XSize=dom_7, YSize=dom_7, Radius=0)  # -> Rectangle, Length
flatten_2 = FlattenTree(Tree=rectangle_4.Rectangle, Path="{0}")
flatten_3 = FlattenTree(Tree=area_6.Centroid, Path="{0}")
flatten_4 = FlattenTree(Tree=rectangle_5.Rectangle, Path="{0}")
flatten_5 = FlattenTree(Tree=area_5.Centroid, Path="{0}")
brep = Brep([<brep referenced from the Rhino model> x2])
srf_3 = Surface([<surface referenced from the Rhino model> x22])
srf_4 = Surface([<surface referenced from the Rhino model> x8])
item_11 = ListItem(List=area_7.Centroid, Index=cset.Set, Wrap=True)
panel_12 = Panel(loop_end)
mcol = MeshColours(Mesh=graft(cull_6), Colours=graft(loop_end))
panel_13 = Panel(hsv_2)
area_8 = Area(Geometry=rectangle_7.Rectangle)  # -> Area, Centroid
area_9 = Area(Geometry=rectangle_8.Rectangle)  # -> Area, Centroid
area_10 = Area(Geometry=rectangle_9.Rectangle)  # -> Area, Centroid
area_11 = Area(Geometry=rectangle_6.Rectangle)  # -> Area, Centroid
area_12 = Area(Geometry=rectangle_11.Rectangle)  # -> Area, Centroid
area_13 = Area(Geometry=rectangle_10.Rectangle)  # -> Area, Centroid
rec_3 = DataRecorder(item_11, DataLimit=-10, RecordData=True)
flatten_6 = FlattenTree(Tree=rectangle_6.Rectangle, Path="{0}")
flatten_7 = FlattenTree(Tree=area_11.Centroid, Path="{0}")
flatten_8 = FlattenTree(Tree=rectangle_7.Rectangle, Path="{0}")
flatten_9 = FlattenTree(Tree=area_8.Centroid, Path="{0}")
flatten_10 = FlattenTree(Tree=rectangle_8.Rectangle, Path="{0}")
flatten_11 = FlattenTree(Tree=area_9.Centroid, Path="{0}")
flatten_12 = FlattenTree(Tree=rectangle_9.Rectangle, Path="{0}")
flatten_13 = FlattenTree(Tree=area_10.Centroid, Path="{0}")
flatten_14 = FlattenTree(Tree=rectangle_10.Rectangle, Path="{0}")
flatten_15 = FlattenTree(Tree=area_13.Centroid, Path="{0}")
flatten_16 = FlattenTree(Tree=rectangle_11.Rectangle, Path="{0}")
flatten_17 = FlattenTree(Tree=area_12.Centroid, Path="{0}")
panel_14 = Panel(rep)
area_14 = Area(Geometry=mcol)  # -> Area, Centroid
dam_2 = DataDam(DataA=rec_3, BufferDelay=10000000, BufferMode=0)
data = Data(dam_2)  # disabled
item_12 = ListItem(List=cull_6, Index=cset.Set, Wrap=True)
item_13 = ListItem(List=area_4.Centroid, Index=cset.Set, Wrap=True)
crv_12 = Curve([<curve referenced from the Rhino model> x15])  # disabled
area_15 = Area(Geometry=crv_12)  # -> Area, Centroid; disabled
flatten_18 = FlattenTree(Tree=loop_end, Path="{0}")  # disabled
flatten_19 = FlattenTree(Tree=area_14.Centroid, Path="{0}")  # disabled
panel_15 = Panel("0,0,0")  # disabled
tmatch = MatchText(Text=flatten_18, Pattern=panel_15, Case=True)  # disabled
rec_4 = DataRecorder(divlength.Points, DataLimit=-10, RecordData=True)
cull_7 = CullPattern(List=flatten_19, CullPattern=invert(tmatch))  # disabled
number_slider_18 = Slider(0.99, range=0..0.99)
recorded_data = Data(Tree({0;0;0;0}: [Point(8.26992187, 2.619035527, 0), Point(8.133638165, 2.765414321, 0), Point(7.997354459, 2.911793116, 0), Point(7.861070754, 3.058171911, 0), Point(7.724787049, 3.204550705, 0), Point(7.588503343, 3.3509295, 0), Point(7.452219638, 3.497308295, 0), Point(7.315935932, 3.643687089, 0), Point(7.179652227, 3.790065884, 0), Point(7.045581183, 3.938397572, 0), Point(6.946403651, 4.111059539, 0), Point(6.921542959, 4.308187963, 0), Point(6.77173997, 4.351426099, 0), Point(6.912392962, 4.295819337, 0), Point(7.075985213, 4.219383138, 0), Point(7.14301719, 4.03141808, 0), Point(7.228451687, 3.857177153, 0), Point(7.423154776, 3.816255427, 0), Point(7.570434323, 3.692648808, 0)], {0;0;1;0}: [Point(6.419839893, 3.010191464, 0), Point(6.604880032, 3.08608709, 0), Point(6.789920172, 3.161982717, 0), Point(6.975126709, 3.237470561, 0), Point(7.160164354, 3.313368077, 0), Point(7.342511742, 3.395447082, 0), Point(7.510836745, 3.502175682, 0), Point(7.540935196, 3.681447225, 0), Point(7.389163503, 3.80845993, 0), Point(7.198348396, 3.849171805, 0), Point(7.125116704, 3.971639749, 0), Point(6.976767751, 4.088479523, 0), Point(6.822299892, 4.214713692, 0), Point(6.788286256, 4.342898216, 0), Point(6.8990392, 4.441705317, 0), Point(7.081031814, 4.519837203, 0), Point(7.229445443, 4.644821822, 0), Point(7.284912756, 4.831230887, 0), Point(7.410599667, 4.986352058, 0)], {0;0;2;0}: [Point(6.965459745, 3.340869622, 0), Point(6.935282911, 3.538579912, 0), Point(6.905106077, 3.736290202, 0), Point(6.874929244, 3.934000491, 0), Point(6.843595558, 4.131526684, 0), Point(6.804445594, 4.327626814, 0)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], {0;0;3;0}: [Point(8.849259703, 0.1508062001, 0), Point(8.745751274, 0.3219377434, 0), Point(8.642242844, 0.4930692867, 0), Point(8.538734415, 0.66420083, 0), Point(8.435225985, 0.8353323733, 0), Point(8.331717556, 1.006463917, 0)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], {0;0;4;0}: [Point(5.665958165, 9.558544566, 0), Point(5.719789589, 9.365925311, 0), Point(5.773621012, 9.173306056, 0), Point(5.827452435, 8.980686801, 0), Point(5.881283859, 8.788067546, 0), Point(5.935115282, 8.595448291, 0)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], {0;0;5;0}: [Point(-4.860573887, -3.958221158, 0), Point(-4.68824776, -3.856713987, 0), Point(-4.515921633, -3.755206817, 0), Point(-4.343595505, -3.653699646, 0), Point(-4.171269378, -3.552192475, 0), Point(-3.998943251, -3.450685304, 0)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]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))
cps_3 = ClosestPoints(Point=cull_7, Cloud=area_15.Centroid, Count=3)  # -> ClosestPoint, CPIndex, Distance; disabled
incurves_3 = PointInCurves(Point=cull_7, Curves=crv_12)  # -> Relationship, Index, Point; disabled
data_2 = Data(rec_4)
number_slider_19 = Slider(0.99, range=0..0.99)
flatten_20 = FlattenTree(Tree=cps_3.CPIndex, Path="{0}")  # disabled
pshift = ShiftPaths(Data=data_2, Offset=-1)
cset_2 = CreateSet(List=flatten_20)  # -> Set, Map; disabled
cull_8 = CullPattern(List=cull_7, CullPattern=incurves_3.Relationship)  # disabled
shift_3 = ShiftPaths(Data=divlength.Points, Offset=-1)  # disabled

lng_6 = ListLength(List=pshift)
multiplication_3 = Multiplication(A=lng_6, B=Slider(0.613, range=0..1))
series_4 = Series(Start=0, Step=1, Count=multiplication_3)
item_14 = ListItem(List=pshift, Index=series_4, Wrap=True)

crv_13 = Curve(<curve referenced from the Rhino model>)
crv_14 = Curve(<curve referenced from the Rhino model>)
mindex = MemberIndex(Set=flatten_20, Member=cset_2.Set)  # -> Index, Count; disabled
tstat_2 = TreeStatistics(Tree=mindex.Index)  # -> Paths, Length, Count; disabled
tstat_3 = TreeStatistics(Tree=shift)  # -> Paths, Length, Count
crv_15 = Curve(<curve referenced from the Rhino model>)
crv_16 = Curve(<curve referenced from the Rhino model>)
bnd = Bounds(Numbers=tstat_2.Length)  # disabled
crv_17 = Curve(<curve referenced from the Rhino model>)
crv_18 = Curve(<curve referenced from the Rhino model>)
number_slider_20 = Slider(0.99, range=0..0.99)
remap = RemapNumbers(Value=tstat_2.Length, Source=bnd, Target=Domain(0, 1))  # -> Mapped, Clipped; disabled
lng_7 = ListLength(List=tstat_3.Paths)
gradient = Gradient(
    LowerLimit=0,
    UpperLimit=1,
    Parameter=remap.Mapped,
    stops=[0: RGB(255, 255, 255), 0.25: RGB(230, 255, 224), 0.5: RGB(118, 255, 94), 0.75: RGB(157, 255, 87), 1: RGB(149, 255, 138)])  # disabled
tstat_4 = TreeStatistics(Tree=shift_2)  # -> Paths, Length, Count
division_2 = Division(A=lng_7, B="2")
tstat_5 = TreeStatistics(Tree=pshift)  # -> Paths, Length, Count
lng_8 = ListLength(List=tstat_4.Paths)
partition = PartitionList(List=tstat_3.Paths, Size=division_2)
item_15 = ListItem(List=crv_12, Index=cset_2.Set, Wrap=True)  # disabled
lng_9 = ListLength(List=tstat_5.Paths)
division_3 = Division(A=lng_8, B="4")
bang = ExplodeTree(Data=partition)  # -> _0000, _0001
boundary_3 = BoundarySurfaces(Edges=item_15)  # disabled
division_4 = Division(A=lng_9, B="2")
partition_2 = PartitionList(List=tstat_4.Paths, Size=division_3)
partition_3 = PartitionList(List=tstat_5.Paths, Size=division_4)
previewmat = CustomPreviewMaterials(Geometry=boundary_3, DiffuseColor=gradient)  # disabled
bang_2 = ExplodeTree(Data=partition_2)  # -> _0000, _0001, _0002, _0003
branch = TreeBranch(Tree=shift, Path=bang._0000, MaintainPaths=True)
branch_2 = TreeBranch(Tree=shift, Path=bang._0001, MaintainPaths=True)
bang_3 = ExplodeTree(Data=partition_3)  # -> _0000, _0001
eval = EvaluateCurve(Curve=reparameterize(crv_13), Parameter=number_slider_18)  # -> Point, Tangent, Angle
eval_2 = EvaluateCurve(Curve=reparameterize(crv_14), Parameter=number_slider_18)  # -> Point, Tangent, Angle
branch_3 = TreeBranch(Tree=shift_2, Path=bang_2._0000, MaintainPaths=True)
branch_4 = TreeBranch(Tree=shift_2, Path=bang_2._0001, MaintainPaths=True)
branch_5 = TreeBranch(Tree=shift_2, Path=bang_2._0003, MaintainPaths=True)
branch_6 = TreeBranch(Tree=shift_2, Path=bang_2._0002, MaintainPaths=True)
eval_3 = EvaluateCurve(Curve=reparameterize(crv_16), Parameter=number_slider_20)  # -> Point, Tangent, Angle
eval_4 = EvaluateCurve(Curve=reparameterize(crv_15), Parameter=number_slider_20)  # -> Point, Tangent, Angle
setcam = SetCamera(CameraLocation=eval_2.Point, TargetLocation=eval.Point, Activate=Toggle(False))
branch_7 = TreeBranch(Tree=pshift, Path=bang_3._0000, MaintainPaths=True)
branch_8 = TreeBranch(Tree=pshift, Path=bang_3._0001, MaintainPaths=True)
eval_5 = EvaluateCurve(Curve=reparameterize(crv_17), Parameter=number_slider_19)  # -> Point, Tangent, Angle
eval_6 = EvaluateCurve(Curve=reparameterize(crv_18), Parameter=number_slider_19)  # -> Point, Tangent, Angle

lng_10 = ListLength(List=branch_8)
lng_11 = ListLength(List=branch_7)
multiplication_4 = Multiplication(A=lng_11, B=number_slider_20)
multiplication_5 = Multiplication(A=lng_10, B=number_slider_20)
series_5 = Series(Start=0, Step=1, Count=multiplication_4)
series_6 = Series(Start=0, Step=1, Count=multiplication_5)
item_16 = ListItem(List=branch_7, Index=series_5, Wrap=True)
item_17 = ListItem(List=branch_8, Index=series_6, Wrap=True)
flatten_21 = FlattenTree(Tree=item_16, Path="{0}")
flatten_22 = FlattenTree(Tree=item_17, Path="{0}")

setcam_2 = SetCamera(CameraLocation=eval_6.Point, TargetLocation=eval_5.Point, Activate=Toggle(False))

lng_12 = ListLength(List=branch_2)
lng_13 = ListLength(List=branch)
multiplication_6 = Multiplication(A=lng_13, B=number_slider_18)
multiplication_7 = Multiplication(A=lng_12, B=number_slider_18)
series_7 = Series(Start=0, Step=1, Count=multiplication_6)
series_8 = Series(Start=0, Step=1, Count=multiplication_7)
item_18 = ListItem(List=branch, Index=series_7, Wrap=True)
item_19 = ListItem(List=branch_2, Index=series_8, Wrap=True)
flatten_23 = FlattenTree(Tree=item_18, Path="{0}")
flatten_24 = FlattenTree(Tree=item_19, Path="{0}")

lng_14 = ListLength(List=branch_5)
setcam_3 = SetCamera(CameraLocation=eval_4.Point, TargetLocation=eval_3.Point, Activate=Toggle(False))
lng_15 = ListLength(List=branch_4)
lng_16 = ListLength(List=branch_4)
lng_17 = ListLength(List=branch_3)
multiplication_8 = Multiplication(A=lng_14, B=number_slider_19)
multiplication_9 = Multiplication(A=lng_17, B=number_slider_19)
multiplication_10 = Multiplication(A=lng_15, B=number_slider_19)
multiplication_11 = Multiplication(A=lng_16, B=number_slider_19)
pt_4 = Point(flatten_3)
pt_5 = Point(flatten_5)
series_9 = Series(Start=0, Step=1, Count=multiplication_8)
series_10 = Series(Start=0, Step=1, Count=multiplication_9)
series_11 = Series(Start=0, Step=1, Count=multiplication_10)
series_12 = Series(Start=0, Step=1, Count=multiplication_11)
item_20 = ListItem(List=branch_5, Index=series_9, Wrap=True)
pt_6 = Point(flatten_13)
cps_4 = ClosestPoints(Point=flatten_21, Cloud=flatten_15, Count=3)  # -> ClosestPoint, CPIndex, Distance
item_21 = ListItem(List=branch_3, Index=series_10, Wrap=True)
item_22 = ListItem(List=branch_4, Index=series_11, Wrap=True)
cps_5 = ClosestPoints(Point=flatten_22, Cloud=flatten_17, Count=3)  # -> ClosestPoint, CPIndex, Distance
item_23 = ListItem(List=branch_6, Index=series_12, Wrap=True)
pt_7 = Point(flatten_7)
cps_6 = ClosestPoints(Point=flatten_23, Cloud=flatten_3, Count=3)  # -> ClosestPoint, CPIndex, Distance
pt_8 = Point(flatten_13)
cps_7 = ClosestPoints(Point=flatten_24, Cloud=flatten_5, Count=3)  # -> ClosestPoint, CPIndex, Distance
pline = PolyLine(Vertices=flatten_21, Closed=False)
pline_2 = PolyLine(Vertices=flatten_22, Closed=False)
flatten_25 = FlattenTree(Tree=item_20, Path="{0}")
flatten_26 = FlattenTree(Tree=item_21, Path="{0}")
flatten_27 = FlattenTree(Tree=item_22, Path="{0}")
flatten_28 = FlattenTree(Tree=item_23, Path="{0}")
merge_2 = Merge(Data1=pline, Data2=pline_2)
cps_8 = ClosestPoints(Point=flatten_26, Cloud=flatten_7, Count=3)  # -> ClosestPoint, CPIndex, Distance
cps_9 = ClosestPoints(Point=flatten_25, Cloud=flatten_13, Count=3)  # -> ClosestPoint, CPIndex, Distance
cps_10 = ClosestPoints(Point=flatten_27, Cloud=flatten_13, Count=3)  # -> ClosestPoint, CPIndex, Distance
cps_11 = ClosestPoints(Point=flatten_28, Cloud=flatten_11, Count=3)  # -> ClosestPoint, CPIndex, Distance
number_slider_21 = Slider(0.4, range=0..1)
number_slider_22 = Slider(1, range=0..1)
flatten_29 = FlattenTree(Tree=cps_7.CPIndex, Path="{0}")
flatten_30 = FlattenTree(Tree=cps_6.CPIndex, Path="{0}")
round_center_table_3 = Curve(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)
tables_3 = Curve([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])
crv_19 = Curve(flatten([tables_3, round_center_table_3]))
incurves_4 = PointInCurves(Point=flatten_15, Curves=crv_19)  # -> Relationship, Index, Point
cull_9 = CullPattern(List=flatten_15, CullPattern=invert(incurves_4.Relationship))
crv_20 = Curve([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])
number_slider_23 = Slider(0.272, range=0..1)
number_slider_24 = Slider(1, range=0..1)
number_slider_25 = Slider(0.4, range=0..1)
number_slider_26 = Slider(1, range=0..1)
number_slider_27 = Slider(1, range=0..1)
number_slider_28 = Slider(1, range=0..1)
cset_3 = CreateSet(List=flatten_29)  # -> Set, Map
cset_4 = CreateSet(List=flatten_30)  # -> Set, Map
number_slider_29 = Slider(66, range=0..100)
flatten_31 = FlattenTree(Tree=cps_9.CPIndex, Path="{0}")
flatten_32 = FlattenTree(Tree=cps_10.CPIndex, Path="{0}")
mindex_2 = MemberIndex(Set=flatten_29, Member=cset_3.Set)  # -> Index, Count
number_slider_30 = Slider(0.272, range=0..1)  # disabled
number_slider_31 = Slider(1, range=0..1)  # disabled
flatten_33 = FlattenTree(Tree=cps_8.CPIndex, Path="{0}")
mindex_3 = MemberIndex(Set=flatten_30, Member=cset_4.Set)  # -> Index, Count
flatten_34 = FlattenTree(Tree=cps_11.CPIndex, Path="{0}")
flatten_35 = FlattenTree(Tree=cps_5.CPIndex, Path="{0}")  # disabled
flatten_36 = FlattenTree(Tree=cps_4.CPIndex, Path="{0}")  # disabled
number_slider_32 = Slider(0.272, range=0..1)
number_slider_33 = Slider(1, range=0..1)
number_slider_34 = Slider(0.272, range=0..1)
number_slider_35 = Slider(1, range=0..1)
cset_5 = CreateSet(List=flatten_31)  # -> Set, Map
panel_16 = Panel(tables_3)
number_slider_36 = Slider(1, range=0..1)
number_slider_37 = Slider(1, range=0..1)
cset_6 = CreateSet(List=flatten_32)  # -> Set, Map
bnd_2 = Bounds(Numbers=mindex_2.Count)
dom_8 = ConstructDomain(DomainStart=number_slider_27, DomainEnd=number_slider_28)
cset_7 = CreateSet(List=flatten_33)  # -> Set, Map
panel_17 = Panel(crv_20)
bnd_3 = Bounds(Numbers=mindex_3.Count)
dom_9 = ConstructDomain(DomainStart=number_slider_27, DomainEnd=number_slider_28)
number_slider_38 = Slider(66, range=0..100)
number_slider_39 = Slider(0.272, range=0..1)
number_slider_40 = Slider(1, range=0..1)
swatch_10 = ColourSwatch(SwatchColor=RGB(140, 140, 140))
swatch_11 = ColourSwatch(SwatchColor=RGB(84, 84, 84))
cset_8 = CreateSet(List=flatten_34)  # -> Set, Map
number_slider_41 = Slider(0.272, range=0..1)  # disabled
number_slider_42 = Slider(1, range=0..1)  # disabled
number_slider_43 = Slider(0.272, range=0..1)  # disabled
number_slider_44 = Slider(1, range=0..1)  # disabled
cset_9 = CreateSet(List=flatten_35)  # -> Set, Map; disabled
cset_10 = CreateSet(List=flatten_36)  # -> Set, Map; disabled
explode_6 = Explode(Curve=crv_20, Recursive=True)  # -> Segments, Vertices
mindex_4 = MemberIndex(Set=flatten_31, Member=cset_5.Set)  # -> Index, Count
mindex_5 = MemberIndex(Set=flatten_32, Member=cset_6.Set)  # -> Index, Count
dom_10 = ConstructDomain(DomainStart=Slider(0.275, range=0..1), DomainEnd=Slider(1, range=0..1))
area_16 = Area(Geometry=crv_20)  # -> Area, graft(Centroid)
dom_11 = ConstructDomain(DomainStart=number_slider_30, DomainEnd=number_slider_31)  # disabled
mindex_6 = MemberIndex(Set=flatten_33, Member=cset_7.Set)  # -> Index, Count
dash_4 = DashPattern(Curve=[tables_3, round_center_table_3], Pattern=Slider(0.04, range=0.01..1))  # -> Dashes, Gaps
mindex_7 = MemberIndex(Set=flatten_34, Member=cset_8.Set)  # -> Index, Count
lng_18 = ListLength(List=mindex_2.Count)
item_24 = ListItem(List=flatten_4, Index=cset_3.Set, Wrap=True)
remap_2 = RemapNumbers(Value=mindex_2.Count, Source=bnd_2, Target=dom_8)  # -> Mapped, Clipped
mindex_8 = MemberIndex(Set=flatten_35, Member=cset_9.Set)  # -> Index, Count; disabled
join_3 = JoinCurves(Curves=explode_6.Segments, Preserve=False)
item_25 = ListItem(List=flatten_2, Index=cset_4.Set, Wrap=True)
mindex_9 = MemberIndex(Set=flatten_36, Member=cset_10.Set)  # -> Index, Count; disabled
lng_19 = ListLength(List=mindex_3.Count)
bnd_4 = Bounds(Numbers=mindex_4.Count)
dom_12 = ConstructDomain(DomainStart=number_slider_36, DomainEnd=number_slider_37)
bnd_5 = Bounds(Numbers=mindex_5.Count)
dom_13 = ConstructDomain(DomainStart=number_slider_36, DomainEnd=number_slider_37)
remap_3 = RemapNumbers(Value=mindex_3.Count, Source=bnd_3, Target=dom_9)  # -> Mapped, Clipped
pline_3 = PolyLine(Vertices=[branch_7, branch_8], Closed=False)
bnd_6 = Bounds(Numbers=mindex_6.Count)
dom_14 = ConstructDomain(DomainStart=number_slider_36, DomainEnd=number_slider_37)

lng_20 = ListLength(List=mindex_8.Count)  # disabled
random_2 = Random(Range=dom_11, Number=lng_20, Seed=2)  # disabled

pipe = Pipe(Curve=dash_4.Dashes, Radius=Slider(0.01, range=0.01..1), Caps=0)
scale = Scale(Geometry=join_3, Center=area_16.Centroid, Factor=0.5)  # -> Geometry, Transform
bnd_7 = Bounds(Numbers=mindex_7.Count)
dom_15 = ConstructDomain(DomainStart=number_slider_36, DomainEnd=number_slider_37)
random_3 = Random(Range=dom_10, Number=lng_18, Seed=number_slider_29)
bnd_8 = Bounds(Numbers=mindex_8.Count)  # disabled
dom_16 = ConstructDomain(DomainStart=number_slider_41, DomainEnd=number_slider_42)  # disabled
bnd_9 = Bounds(Numbers=mindex_9.Count)  # disabled
dom_17 = ConstructDomain(DomainStart=number_slider_43, DomainEnd=number_slider_44)  # disabled
area_17 = Area(Geometry=item_24)  # -> Area, Centroid
data_3 = Data([0.4960093941, 0.4811758665, 0.9372810887, 0.7748255774, 0.3675984064, 0.5149489226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])
dom_18 = ConstructDomain(DomainStart=Slider(0.275, range=0..1), DomainEnd=Slider(1, range=0..1))
area_18 = Area(Geometry=item_25)  # -> Area, Centroid
dom_19 = ConstructDomain(DomainStart=Slider(0.275, range=0..1), DomainEnd=Slider(1, range=0..1))
random_4 = Random(Range=dom_10, Number=lng_19, Seed=number_slider_29)
data_4 = Data([0.4960093941, 0.4811758665, 0.9372810887, 0.7748255774, 0.3675984064, 0.5149489226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])
dom_20 = ConstructDomain(DomainStart=Slider(0.275, range=0..1), DomainEnd=Slider(1, range=0..1))
lng_21 = ListLength(List=mindex_4.Count)
data_5 = Data([0.4761672443, 0.4607497196, 0.9348118402, 0.7659604427, 0.3427007058, 0.4958524235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])
item_26 = ListItem(List=flatten_10, Index=cset_5.Set, Wrap=True)
remap_4 = RemapNumbers(Value=mindex_4.Count, Source=bnd_4, Target=dom_12)  # -> Mapped, Clipped
lng_22 = ListLength(List=mindex_5.Count)
item_27 = ListItem(List=flatten_12, Index=cset_6.Set, Wrap=True)
remap_5 = RemapNumbers(Value=mindex_5.Count, Source=bnd_5, Target=dom_13)  # -> Mapped, Clipped
preview = CustomPreview(Geometry=pipe, Material=swatch_11)
item_28 = ListItem(List=flatten_6, Index=cset_7.Set, Wrap=True)
previewlw_8 = CustomPreviewLineweights(Geometry=pipe, Shader=swatch_11, Absolute=False)
lng_23 = ListLength(List=mindex_6.Count)
lng_24 = ListLength(List=mindex_7.Count)
item_29 = ListItem(List=flatten_8, Index=cset_8.Set, Wrap=True)
data_6 = Data([0.4761672443, 0.4607497196, 0.9348118402, 0.7659604427, 0.3427007058, 0.4958524235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])
remap_6 = RemapNumbers(Value=mindex_7.Count, Source=bnd_7, Target=dom_15)  # -> Mapped, Clipped
remap_7 = RemapNumbers(Value=mindex_6.Count, Source=bnd_6, Target=dom_14)  # -> Mapped, Clipped
item_30 = ListItem(List=flatten_16, Index=cset_9.Set, Wrap=True)  # disabled
gradient_2 = Gradient(LowerLimit=0, UpperLimit=1, Parameter=random_4, stops=[0: RGB(38, 38, 38), 0.5: RGB(76, 82, 186), 1: RGB(68, 0, 255)])
item_31 = ListItem(List=flatten_14, Index=cset_10.Set, Wrap=True)  # disabled
scale_2 = Scale(Geometry=item_24, Center=area_17.Centroid, Factor=random_3)  # -> Geometry, Transform
remap_8 = RemapNumbers(Value=mindex_9.Count, Source=bnd_9, Target=dom_17)  # -> Mapped, Clipped; disabled
remap_9 = RemapNumbers(Value=mindex_8.Count, Source=bnd_8, Target=dom_16)  # -> Mapped, Clipped; disabled
scale_3 = Scale(Geometry=item_25, Center=area_18.Centroid, Factor=random_4)  # -> Geometry, Transform
data_7 = Data([0.833356358, 0.566230369, 0.392847032, 0.9891142543, 0.3513553732, 0.495263337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])  # disabled
gradient_3 = Gradient(LowerLimit=0, UpperLimit=1, Parameter=random_3, stops=[0: RGB(38, 38, 38), 0.5: RGB(146, 76, 186), 1: RGB(255, 0, 187)])
random_5 = Random(Range=dom_18, Number=lng_21, Seed=number_slider_38)
panel_18 = Panel(scale.Geometry)
random_6 = Random(Range=dom_19, Number=lng_22, Seed=number_slider_38)
area_19 = Area(Geometry=item_26)  # -> Area, Centroid
area_20 = Area(Geometry=item_27)  # -> Area, Centroid
data_8 = Data([0.4960093941, 0.4811758665, 0.9372810887, 0.7748255774, 0.3675984064, 0.5149489226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])
area_21 = Area(Geometry=item_28)  # -> Area, Centroid
random_7 = Random(Range=dom_19, Number=lng_23, Seed=number_slider_38)
swatch_12 = ColourSwatch(SwatchColor=RGB(255, 15, 235))
random_8 = Random(Range=dom_20, Number=lng_24, Seed=number_slider_38)
runion = RegionUnion(Curves=tables_3)
swatch_13 = ColourSwatch(SwatchColor=RGB(83, 15, 255))
explode_7 = Explode(Curve=scale_2.Geometry, Recursive=True)  # -> Segments, Vertices
area_22 = Area(Geometry=item_29)  # -> Area, Centroid
data_9 = Data([0.4960093941, 0.4811758665, 0.9372810887, 0.7748255774, 0.3675984064, 0.5149489226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])
data_10 = Data([0.4761672443, 0.4607497196, 0.9348118402, 0.7659604427, 0.3427007058, 0.4958524235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])
data_11 = Data([0.4960093941, 0.4811758665, 0.9372810887, 0.7748255774, 0.3675984064, 0.5149489226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])
explode_8 = Explode(Curve=scale_3.Geometry, Recursive=True)  # -> Segments, Vertices
data_12 = Data([0.4761672443, 0.4607497196, 0.9348118402, 0.7659604427, 0.3427007058, 0.4958524235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])
area_23 = Area(Geometry=item_30)  # -> Area, Centroid; disabled
area_24 = Area(Geometry=item_31)  # -> Area, Centroid; disabled
data_13 = Data([0.4960093941, 0.4811758665, 0.9372810887, 0.7748255774, 0.3675984064, 0.5149489226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])
data_14 = Data([0.4761672443, 0.4607497196, 0.9348118402, 0.7659604427, 0.3427007058, 0.4958524235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])
data_15 = Data([0.4761672443, 0.4607497196, 0.9348118402, 0.7659604427, 0.3427007058, 0.4958524235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])
gradient_4 = Gradient(
    LowerLimit=0,
    UpperLimit=1,
    Parameter=remap_7.Mapped,
    stops=[0: RGB(38, 38, 38), 0.5: RGB(186, 76, 135), 1: RGB(242, 0, 255)])
scale_4 = Scale(Geometry=item_26, Center=area_19.Centroid, Factor=remap_4.Mapped)  # -> Geometry, Transform
scale_5 = Scale(Geometry=item_27, Center=area_20.Centroid, Factor=remap_5.Mapped)  # -> Geometry, Transform
scale_6 = Scale(Geometry=item_28, Center=area_21.Centroid, Factor=remap_7.Mapped)  # -> Geometry, Transform
gradient_5 = Gradient(
    LowerLimit=0,
    UpperLimit=1,
    Parameter=remap_4.Mapped,
    stops=[0: RGB(38, 38, 38), 0.5: RGB(186, 135, 76), 1: RGB(255, 187, 0)])
conmesh = ConstructMesh(Vertices=explode_7.Vertices, Faces={A=0, B=1, C=2, D=3}, Colours=graft(gradient_3))  # -> flatten(Mesh); disabled
gradient_6 = Gradient(
    LowerLimit=0,
    UpperLimit=1,
    Parameter=remap_5.Mapped,
    stops=[0: RGB(38, 38, 38), 0.5: RGB(186, 93, 76), 1: RGB(255, 81, 0)])
conmesh_2 = ConstructMesh(Vertices=explode_8.Vertices, Faces={A=0, B=1, C=2, D=3}, Colours=graft(gradient_2))  # -> flatten(Mesh); disabled
scale_7 = Scale(Geometry=item_29, Center=area_22.Centroid, Factor=remap_6.Mapped)  # -> Geometry, Transform
scale_8 = Scale(Geometry=item_30, Center=area_23.Centroid, Factor=data_7)  # -> Geometry, Transform; disabled
gradient_7 = Gradient(
    LowerLimit=0,
    UpperLimit=1,
    Parameter=remap_6.Mapped,
    stops=[0: RGB(38, 38, 38), 0.5: RGB(162, 186, 76), 1: RGB(242, 255, 0)])
scale_9 = Scale(Geometry=item_31, Center=area_24.Centroid, Factor=remap_8.Mapped)  # -> Geometry, Transform; disabled
swatch_14 = ColourSwatch(SwatchColor=RGB(211, 255, 15))
swatch_15 = ColourSwatch(SwatchColor=RGB(255, 15, 235))
explode_9 = Explode(Curve=scale_4.Geometry, Recursive=True)  # -> Segments, Vertices
swatch_16 = ColourSwatch(SwatchColor=RGB(83, 15, 255))
explode_10 = Explode(Curve=scale_5.Geometry, Recursive=True)  # -> Segments, Vertices
explode_11 = Explode(Curve=scale_6.Geometry, Recursive=True)  # -> Segments, Vertices
swatch_17 = ColourSwatch(SwatchColor=RGB(211, 255, 15))
item_32 = ListItem(List=graft(runion), Index=0, Wrap=True)
explode_12 = Explode(Curve=scale_7.Geometry, Recursive=True)  # -> Segments, Vertices
swatch_18 = ColourSwatch(SwatchColor=RGB(255, 15, 235))  # disabled
offmsh = OffsetMesh(Mesh=conmesh, Distance=remap_2.Mapped, BothSides=0, CreateSolid=True)  # disabled
explode_13 = Explode(Curve=scale_8.Geometry, Recursive=True)  # -> Segments, Vertices; disabled
swatch_19 = ColourSwatch(SwatchColor=RGB(186, 186, 186))  # disabled
swatch_20 = ColourSwatch(SwatchColor=RGB(83, 15, 255))  # disabled
offmsh_2 = OffsetMesh(Mesh=conmesh_2, Distance=remap_3.Mapped, BothSides=0, CreateSolid=True)  # disabled
explode_14 = Explode(Curve=scale_9.Geometry, Recursive=True)  # -> Segments, Vertices; disabled
offset = OffsetCurve(Curve=item_32, Distance=Slider(0.08, range=0.01..1), Corners=1)
conmesh_3 = ConstructMesh(Vertices=explode_9.Vertices, Faces={A=0, B=1, C=2, D=3}, Colours=graft(gradient_5))  # -> flatten(Mesh)
conmesh_4 = ConstructMesh(Vertices=explode_10.Vertices, Faces={A=0, B=1, C=2, D=3}, Colours=graft(gradient_6))  # -> flatten(Mesh)
conmesh_5 = ConstructMesh(Vertices=explode_11.Vertices, Faces={A=0, B=1, C=2, D=3}, Colours=graft(gradient_4))  # -> flatten(Mesh)
explode_15 = Explode(Curve=offset, Recursive=True)  # -> flatten(Segments), Vertices
conmesh_6 = ConstructMesh(Vertices=explode_12.Vertices, Faces={A=0, B=1, C=2, D=3}, Colours=graft(gradient_7))  # -> flatten(Mesh)
conmesh_7 = ConstructMesh(Vertices=explode_13.Vertices, Faces={A=0, B=1, C=2, D=3}, Colours=swatch_18)  # -> flatten(Mesh); disabled
conmesh_8 = ConstructMesh(Vertices=explode_14.Vertices, Faces={A=0, B=1, C=2, D=3}, Colours=swatch_20)  # -> flatten(Mesh); disabled
len_3 = Length(Curve=explode_15.Segments)
offmsh_3 = OffsetMesh(Mesh=conmesh_3, Distance=remap_4.Mapped, BothSides=0, CreateSolid=True)  # disabled
offmsh_4 = OffsetMesh(Mesh=conmesh_4, Distance=remap_5.Mapped, BothSides=0, CreateSolid=True)  # disabled
offmsh_5 = OffsetMesh(Mesh=conmesh_5, Distance=remap_7.Mapped, BothSides=0, CreateSolid=True)  # disabled
offmsh_6 = OffsetMesh(Mesh=conmesh_6, Distance=remap_6.Mapped, BothSides=0, CreateSolid=True)  # disabled
offmsh_7 = OffsetMesh(Mesh=conmesh_7, Distance=remap_9.Mapped, BothSides=0, CreateSolid=True)  # disabled
offmsh_8 = OffsetMesh(Mesh=conmesh_8, Distance=remap_8.Mapped, BothSides=0, CreateSolid=True)  # disabled
sort_2 = SortList(Keys=len_3)  # -> Keys, ValuesA
item_33 = ListItem(List=sort_2.Keys, Index=Slider(1, range=1..17), Wrap=True)
viewer = ParamViewer(item_32)
panel_19 = Panel(len_3)
mesh = MeshBrep(
    Brep=scale.Geometry,
    Settings={GridMaxCount=0, GridMinCount=16, JaggedSeams=False, MaxEdgeLength=0, MinEdgeLength=0.0001, MinTolerance=0, Refine=True, RefineAngle=0, RelativeTolerance=0.65, SimplePlanes=True, Tolerance=0})  # -> flatten(Mesh)

# ---- group: it'll generate random seats
int = Integer([multiplication_5, multiplication_4])
ma = MassAddition(Input=int)  # -> Result, PartialResults
random_9 = Random(Range=Domain(0, 1), Number=ma.Result, Seed=Slider(100, range=0..100))  # -> flatten(Random)
pt_9 = Point(Tree({0;0}: [Point(6.864259454, 8.693082513, 0), Point(6.614259454, 8.693082513, 0)], {0;1}: [Point(3.581632289, 8.959517113, 0), Point(3.331632289, 8.959517113, 0)], {0;2}: [Point(3.766111215, 8.156737043, 0), Point(3.930141795, 8.345400683, 0)], {0;3}: [Point(4.716048182, 8.833668394, 0), Point(4.966048182, 8.833668394, 0), Point(5.216048182, 8.833668394, 0), Point(5.466048182, 8.833668394, 0)], {0;4}: [Point(6.456845636, 6.938423405, 0), Point(6.635517331, 6.763562244, 0), Point(6.814189026, 6.588701083, 0)], {0;5}: [Point(2.977267195, 7.755529488, 0), Point(3.157028615, 7.581788785, 0), Point(3.336790036, 7.408048082, 0), Point(3.516551456, 7.23430738, 0)]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))
panel_20 = Panel(random_9)
sph = Sphere(Base=pt_9, Radius=Slider(0.035, range=0..0.1))
round_2 = Round(Number=panel_20)  # -> Nearest, Floor, Ceiling
panel_21 = Panel("""-1
-2
-3
-4""")
item_34 = ListItem(List=round_2.Nearest, Index=panel_21, Wrap=True)
dispatch = Dispatch(List=mesh, DispatchPattern=item_34)  # -> ListA, ListB
preview_2 = CustomPreview(Geometry=dispatch.ListA, Material=ColourSwatch(SwatchColor=RGB(255, 191, 0)))

# ----
bbox = BoundingBox(Content=sph, Plane=PlaneXY(0, 0, 0))  # -> Box, Box_2
lng_25 = ListLength(List=panel_19)
range = Range(Domain=Domain(0, 1), Steps=10)
panel_22 = Panel(round_2.Nearest)
data_16 = Data(Tree({0;0;0;0}: [Point(8.26992187, 2.619035527, 0), Point(8.133638165, 2.765414321, 0), Point(7.997354459, 2.911793116, 0), Point(7.861070754, 3.058171911, 0), Point(7.724787049, 3.204550705, 0), Point(7.588503343, 3.3509295, 0), Point(7.452219638, 3.497308295, 0), Point(7.315935932, 3.643687089, 0), Point(7.179652227, 3.790065884, 0), Point(7.045581183, 3.938397572, 0), Point(6.946403651, 4.111059539, 0), Point(6.921542959, 4.308187963, 0), Point(6.77173997, 4.351426099, 0), Point(6.912392962, 4.295819337, 0), Point(7.075985213, 4.219383138, 0), Point(7.14301719, 4.03141808, 0), Point(7.228451687, 3.857177153, 0), Point(7.423154776, 3.816255427, 0), Point(7.570434323, 3.692648808, 0)], {0;0;1;0}: [Point(6.419839893, 3.010191464, 0), Point(6.604880032, 3.08608709, 0), Point(6.789920172, 3.161982717, 0), Point(6.975126709, 3.237470561, 0), Point(7.160164354, 3.313368077, 0), Point(7.342511742, 3.395447082, 0), Point(7.510836745, 3.502175682, 0), Point(7.540935196, 3.681447225, 0), Point(7.389163503, 3.80845993, 0), Point(7.198348396, 3.849171805, 0), Point(7.125116704, 3.971639749, 0), Point(6.976767751, 4.088479523, 0), Point(6.822299892, 4.214713692, 0), Point(6.788286256, 4.342898216, 0), Point(6.8990392, 4.441705317, 0), Point(7.081031814, 4.519837203, 0), Point(7.229445443, 4.644821822, 0), Point(7.284912756, 4.831230887, 0), Point(7.410599667, 4.986352058, 0)], {0;0;2;0}: [Point(6.965459745, 3.340869622, 0), Point(6.935282911, 3.538579912, 0), Point(6.905106077, 3.736290202, 0), Point(6.874929244, 3.934000491, 0), Point(6.843595558, 4.131526684, 0), Point(6.804445594, 4.327626814, 0)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], {0;0;3;0}: [Point(8.849259703, 0.1508062001, 0), Point(8.745751274, 0.3219377434, 0), Point(8.642242844, 0.4930692867, 0), Point(8.538734415, 0.66420083, 0), Point(8.435225985, 0.8353323733, 0), Point(8.331717556, 1.006463917, 0)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], {0;0;4;0}: [Point(5.665958165, 9.558544566, 0), Point(5.719789589, 9.365925311, 0), Point(5.773621012, 9.173306056, 0), Point(5.827452435, 8.980686801, 0), Point(5.881283859, 8.788067546, 0), Point(5.935115282, 8.595448291, 0)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], {0;0;5;0}: [Point(-4.860573887, -3.958221158, 0), Point(-4.68824776, -3.856713987, 0), Point(-4.515921633, -3.755206817, 0), Point(-4.343595505, -3.653699646, 0), Point(-4.171269378, -3.552192475, 0), Point(-3.998943251, -3.450685304, 0)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]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))
panel_23 = Panel(dispatch.ListA)
shift_4 = ShiftPaths(Data=data_16, Offset=-1)
pline_4 = PolyLine(Vertices=demesh.Vertices, Closed=True)
tstat_6 = TreeStatistics(Tree=shift_4)  # -> Paths, Length, Count
flatten_37 = FlattenTree(Tree=pline_4, Path="{0}")
series_13 = Series(Start=0, Step=1, Count=10)
item_35 = ListItem(List=demesh.Vertices, Index=0, Wrap=True)
explode_16 = Explode(Curve=flatten_37, Recursive=True)  # -> Segments, Vertices
panel_24 = Panel(pline_4)
panel_25 = Panel(flatten_37)
item_36 = ListItem(List=explode_16.Segments, Index=Slider(1, range=0..10), Wrap=True)
item_37 = ListItem(List=explode_16.Segments, Index=Slider(1, range=0..10), Wrap=True)
dispatch_2 = Dispatch(List=tstat_6.Paths, DispatchPattern=[True, False])  # -> ListA, ListB
ln = Line(StartPoint=graft(area_3.Centroid), EndPoint=item_35)
lng_26 = ListLength(List=shift_4)
len_4 = Length(Curve=item_36)
len_5 = Length(Curve=item_37)
crv_cp = CurveClosestPoint(Point=area_3.Centroid, Curve=item_37)  # -> Point, Parameter, flatten(Distance)
multiplication_12 = Multiplication(A=lng_26, B=Slider(0.7788, range=0..0.99))
eval_7 = EvaluateCurve(Curve=reparameterize(ln), Parameter="0.50")  # -> Point, Tangent, Angle
division_5 = Division(A=len_5, B="4")
branch_9 = TreeBranch(Tree=shift_4, Path=dispatch_2.ListA, MaintainPaths=True)
branch_10 = TreeBranch(Tree=shift_4, Path=dispatch_2.ListB, MaintainPaths=True)
series_14 = Series(Start=0, Step=1, Count=multiplication_12)
division_6 = Division(A=len_5, B="2")
neg_7 = Negative(Value=division_5)
dom_21 = ConstructDomain(DomainStart=division_5, DomainEnd=neg_7)
item_38 = ListItem(List=shift_4, Index=series_14, Wrap=True)
number_slider_45 = Slider(0.99, range=0..0.99)
panel_26 = Panel(branch_9)
lng_27 = ListLength(List=branch_9)
lng_28 = ListLength(List=branch_10)
multiplication_13 = Multiplication(A=lng_27, B=number_slider_45)
multiplication_14 = Multiplication(A=lng_28, B=number_slider_45)
series_15 = Series(Start=0, Step=1, Count=multiplication_13)
series_16 = Series(Start=0, Step=1, Count=multiplication_14)
neg_8 = Negative(Value=division_6)
rectangle_12 = Rectangle(Plane=eval_7.Point, XSize=dom_21, YSize=dom_21, Radius=0)  # -> Rectangle, Length
Y = UnitY(Factor=neg_8)
item_39 = ListItem(List=branch_9, Index=series_15, Wrap=True)
item_40 = ListItem(List=branch_10, Index=series_16, Wrap=True)
X = UnitX(Factor=division_6)
move = Move(Geometry=rectangle_12.Rectangle, Motion=Y)  # -> Geometry, Transform
move_2 = Move(Geometry=rectangle_12.Rectangle, Motion=X)  # -> Geometry, Transform
flatten_38 = FlattenTree(Tree=item_40, Path="{0}")
flatten_39 = FlattenTree(Tree=item_39, Path="{0}")
move_3 = Move(Geometry=move_2.Geometry, Motion=Y)  # -> Geometry, Transform
tables_4 = Curve([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])
round_center_table_4 = Curve(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)
crv_21 = Curve([tables_4, round_center_table_4])

age_00 = Curve(rectangle_12.Rectangle)
age_01 = Curve(move.Geometry)
age_02 = Curve(move_2.Geometry)
age_03 = Curve(move_3.Geometry)

pt_10 = Point(flatten_39)
male = Curve(rectangle_12.Rectangle)
female = Curve(move_3.Geometry)
incurves_5 = PointInCurves(Point=pt_10, Curves=crv_21)  # -> Relationship, Index, Point
flatten_40 = FlattenTree(Tree=male, Path="{0}")
flatten_41 = FlattenTree(Tree=female, Path="{0}")
cull_10 = CullPattern(List=flatten_39, CullPattern=invert(incurves_5.Relationship))
series_17 = Series(Start=0, Step=Slider(0.5, range=0..1), Count="271")
incurves_6 = PointInCurves(Point=flatten_38, Curves=crv_21)  # -> Relationship, Index, Point
area_25 = Area(Geometry=flatten_40)  # -> Area, Centroid
cull_11 = CullPattern(List=flatten_38, CullPattern=invert(incurves_6.Relationship))
consec = ConsecutiveDomains(Numbers=series_17, Additive=True)
cps_12 = ClosestPoints(Point=cull_10, Cloud=area_25.Centroid, Count=3)  # -> ClosestPoint, CPIndex, Distance
series_18 = Series(Start=0, Step=Slider(0.5, range=0..1), Count="283")
panel_27 = Panel(consec)
flatten_42 = FlattenTree(Tree=cps_12.CPIndex, Path="{0}")
area_26 = Area(Geometry=flatten_41)  # -> Area, Centroid
consec_2 = ConsecutiveDomains(Numbers=series_18, Additive=True)
random_10 = Random(Range=consec, Number=Slider(3, range=0..10), Seed=2)
cset_11 = CreateSet(List=flatten_42)  # -> Set, Map
cps_13 = ClosestPoints(Point=cull_11, Cloud=area_26.Centroid, Count=3)  # -> ClosestPoint, CPIndex, Distance
panel_28 = Panel(random_10)
item_41 = ListItem(List=flatten_40, Index=cset_11.Set, Wrap=True)
panel_29 = Panel(consec_2)
ma_2 = MassAddition(Input=random_10)  # -> flatten(Result), PartialResults
flatten_43 = FlattenTree(Tree=cps_13.CPIndex, Path="{0}")
panel_30 = Panel(ma_2.Result)
random_11 = Random(Range=consec_2, Number=Slider(3, range=0..10), Seed=2)
cset_12 = CreateSet(List=flatten_43)  # -> Set, Map
data_17 = Data(ma_2.Result)
panel_31 = Panel(random_11)
item_42 = ListItem(List=flatten_41, Index=cset_12.Set, Wrap=True)
ma_3 = MassAddition(Input=random_11)  # -> flatten(Result), PartialResults
panel_32 = Panel(ma_3.Result)
lng_29 = ListLength(List=data_17)
data_18 = Data(ma_3.Result)
dom_22 = ConstructDomain(DomainStart=Slider(0.2255, range=0..1), DomainEnd=Slider(0.9561, range=0..1))
bnd_10 = Bounds(Numbers=data_17)
multiplication_15 = Multiplication(A=lng_29, B=number_slider_45)
series_19 = Series(Start=0, Step=1, Count=multiplication_15)
area_27 = Area(Geometry=item_41)  # -> Area, Centroid
remap_10 = RemapNumbers(Value=data_17, Source=bnd_10, Target=dom_22)  # -> Mapped, Clipped
lng_30 = ListLength(List=data_18)
dom_23 = ConstructDomain(DomainStart=Slider(0.2255, range=0..1), DomainEnd=Slider(0.9561, range=0..1))
bnd_11 = Bounds(Numbers=data_18)
item_43 = ListItem(List=remap_10.Mapped, Index=series_19, Wrap=True)
multiplication_16 = Multiplication(A=lng_30, B=number_slider_45)
panel_33 = Panel(remap_10.Mapped)
series_20 = Series(Start=0, Step=1, Count=multiplication_16)
area_28 = Area(Geometry=item_42)  # -> Area, Centroid
remap_11 = RemapNumbers(Value=data_18, Source=bnd_11, Target=dom_23)  # -> Mapped, Clipped
item_44 = ListItem(List=remap_11.Mapped, Index=series_20, Wrap=True)
panel_34 = Panel(remap_11.Mapped)
swatch_21 = ColourSwatch(SwatchColor=RGB(160, 97, 255))
scale_10 = Scale(Geometry=item_41, Center=area_27.Centroid, Factor=remap_10.Mapped)  # -> Geometry, Transform
scale_11 = Scale(Geometry=item_41, Center=area_27.Centroid, Factor=Slider(0.877, range=0..1))  # -> Geometry, Transform
explode_17 = Explode(Curve=scale_10.Geometry, Recursive=True)  # -> Segments, Vertices
swatch_22 = ColourSwatch(SwatchColor=RGB(255, 130, 236))
scale_12 = Scale(Geometry=item_42, Center=area_28.Centroid, Factor=Slider(0.877, range=0..1))  # -> Geometry, Transform
scale_13 = Scale(Geometry=item_42, Center=area_28.Centroid, Factor=remap_11.Mapped)  # -> Geometry, Transform
gradient_8 = Gradient(LowerLimit=0, UpperLimit=1, Parameter=item_43, stops=[0.15: RGB(255, 255, 255), 0.8: RGB(80, 0, 219)])
explode_18 = Explode(Curve=scale_13.Geometry, Recursive=True)  # -> Segments, Vertices
gradient_9 = Gradient(LowerLimit=0, UpperLimit=1, Parameter=item_44, stops=[0.15: RGB(255, 255, 255), 0.8: RGB(219, 0, 186)])
previewlw_9 = CustomPreviewLineweights(Geometry=scale_11.Geometry, Shader=ColourSwatch(SwatchColor=RGB(102, 0, 255)), Absolute=False)
conmesh_9 = ConstructMesh(Vertices=explode_17.Vertices, Faces={A=0, B=1, C=2, D=3}, Colours=graft(gradient_8))
previewlw_10 = CustomPreviewLineweights(Geometry=scale_12.Geometry, Shader=ColourSwatch(SwatchColor=RGB(255, 48, 224)), Absolute=False)
conmesh_10 = ConstructMesh(Vertices=explode_18.Vertices, Faces={A=0, B=1, C=2, D=3}, Colours=graft(gradient_9))

# ---- group: tables
crv_22 = Curve(flatten(merge_2))
incurves_7 = PointInCurves(Point=area_2.Centroid, Curves=tables_3)  # -> Relationship, Index, Point
cull_12 = CullPattern(List=explode_2, CullPattern=incurves_7.Relationship)

# ----
panel_35 = Panel(crv_22)
medges_3 = MeshEdges(Mesh=cull_12)  # -> NakedEdges, InteriorEdges, NonManifoldEdges
crv_23 = Curve(medges_3.NakedEdges)

# ---- group: tables (continued)
join_4 = JoinCurves(Curves=crv_23, Preserve=False)  # -> flatten(Curves)
runion_2 = RegionUnion(Curves=join_4)
crvprox = CurveProximity(CurveA=graft(runion_2), CurveB=crv_22)  # -> PointA, PointB, Distance
ma_4 = MassAddition(Input=crvprox.Distance)  # -> flatten(Result), PartialResults
bnd_12 = Bounds(Numbers=ma_4.Result)
remap_12 = RemapNumbers(Value=ma_4.Result, Source=bnd_12, Target=Domain(0, 1))  # -> Mapped, Clipped
gradient_10 = Gradient(
    LowerLimit=0,
    UpperLimit=1,
    Parameter=remap_12.Mapped,
    stops=[0: RGB(0, 98, 0), 0.119: RGB(81, 175, 17), 0.542: RGB(159, 198, 146), 0.911: RGB(170, 235, 41)])

# ----
boundary_4 = BoundarySurfaces(Edges=runion_2)

# ---- group: tables (continued)
preview_3 = CustomPreview(Geometry=boundary_4, Material=gradient_10)
